# Grasshopper definition mesh model construct.gh (Grasshopper 1.0.8)
# plug-ins: Pufferfish

number_slider = Slider(4.11, range=0..10)
number_slider_2 = Slider(4, range=0..100)
brep = Brep([<brep referenced from the Rhino model> x59])
unit_z = UnitZ(Factor=Slider(-0.2, range=-1..1))
extrude = Extrude(Base=brep, Direction=unit_z)
series = Series(Start=Slider(0, range=0..100), Step=number_slider, Count=Slider(300, range=0..1000))
number_slider_3 = Slider(4, range=0..100)
point = Point(Point(-362, -891.0308173, 0))
unit_x = UnitX(Factor=series)
solid_union = SolidUnion(Breps=extrude)
series_2 = Series(Start=Slider(0, range=0..100), Step=number_slider, Count=Slider(400, range=0..1000))
list_item = ListItem(List=solid_union, Index=Slider(1, range=0..100), Wrap=True)
move = Move(Geometry=point, Motion=unit_x)  # -> Geometry, Transform
unit_z_2 = UnitZ(Factor=Slider(2000, range=0..10000))
mesh_brep = MeshBrep(
    Brep=list_item,
    Settings={GridMaxCount=0, GridMinCount=16, JaggedSeams=False, MaxEdgeLength=0, MinEdgeLength=0.0001, MinTolerance=0, Refine=True, RefineAngle=0, RelativeTolerance=0.65, SimplePlanes=True, Tolerance=0})
unit_y = UnitY(Factor=series_2)
move_2 = Move(Geometry=graft(move.Geometry), Motion=unit_y)  # -> Geometry, Transform
mesh = Mesh(mesh_brep)
move_3 = Move(Geometry=move_2.Geometry, Motion=unit_z_2)  # -> Geometry, Transform
unit_z_3 = UnitZ(Factor=1)
project_point = ProjectPoint(Point=flatten(move_2.Geometry), Direction=unit_z_3, Geometry=mesh)  # -> flatten(Point), Index
project_point_2 = ProjectPoint(Point=flatten(move_3.Geometry), Direction=Vector(0, 0, -1), Geometry=mesh)  # -> flatten(Point), Index
null_item = NullItem(Item=project_point.Point)  # -> NullFlags, InvalidFlags, Description
null_item_2 = NullItem(Item=project_point_2.Point)  # -> NullFlags, InvalidFlags, Description
cull_pattern = CullPattern(List=project_point.Point, CullPattern=invert(null_item.InvalidFlags))
cull_pattern_2 = CullPattern(List=project_point_2.Point, CullPattern=invert(null_item_2.InvalidFlags))
delaunay_mesh = DelaunayMesh(Points=cull_pattern_2, Plane=PlaneXY(0, 0, 0))
delaunay_mesh_2 = DelaunayMesh(Points=cull_pattern, Plane=PlaneXY(0, 0, 0))
number_slider_4 = Slider(55, range=0..100)
face_circles = FaceCircles(Mesh=delaunay_mesh_2)  # -> Centers, Ratio
face_circles_2 = FaceCircles(Mesh=delaunay_mesh)  # -> Centers, Ratio
deconstruct_mesh = DeconstructMesh(Mesh=delaunay_mesh_2)  # -> Vertices, Faces, Colours, Normals
deconstruct_mesh_2 = DeconstructMesh(Mesh=delaunay_mesh)  # -> Vertices, Faces, Colours, Normals
larger_than = LargerThan(FirstNumber=face_circles.Centers, SecondNumber=number_slider_4)  # -> LargerThan, OrEqualTo
larger_than_2 = LargerThan(FirstNumber=face_circles_2.Centers, SecondNumber=number_slider_4)  # -> LargerThan, OrEqualTo
replace_items = ReplaceItems(List=larger_than.LargerThan, Item="True", Indices=Slider(0, range=0..100), Wrap=False)
dispatch = Dispatch(List=deconstruct_mesh.Faces, DispatchPattern=replace_items)  # -> ListA, ListB
replace_items_2 = ReplaceItems(List=larger_than_2.LargerThan, Item="True", Indices=Slider(0, range=0..100), Wrap=False)
dispatch_2 = Dispatch(List=deconstruct_mesh_2.Faces, DispatchPattern=replace_items_2)  # -> ListA, ListB
construct_mesh = ConstructMesh(Vertices=deconstruct_mesh_2.Vertices, Faces=dispatch_2.ListB)
construct_mesh_2 = ConstructMesh(Vertices=deconstruct_mesh.Vertices, Faces=dispatch.ListB)
number_slider_5 = Slider(1, range=0..10)
boolean_toggle = BooleanToggle(False)
remeshbycolour = RemeshByColour(Mesh=construct_mesh, LengthInterval=Domain(5, 10), Flip=1, Iterations=number_slider_5, Reset=boolean_toggle)
remeshbycolour_2 = RemeshByColour(Mesh=construct_mesh_2, LengthInterval=Domain(5, 10), Flip=1, Iterations=number_slider_5, Reset=boolean_toggle)
mesh_edges = MeshEdges(Mesh=remeshbycolour_2)  # -> NakedEdges, InteriorEdges, NonManifoldEdges
mesh_edges_2 = MeshEdges(Mesh=remeshbycolour)  # -> NakedEdges, InteriorEdges, NonManifoldEdges
curve = Curve(mesh_edges_2.NakedEdges)
curve_2 = Curve(mesh_edges.NakedEdges)
join_curves = JoinCurves(Curves=curve, Preserve=False)
join_curves_2 = JoinCurves(Curves=curve_2, Preserve=False)
end_points = EndPoints(Curve=join_curves)  # -> Start, End
align_curve_seams = AlignCurveSeams(Curves=join_curves_2, Guide=end_points.Start, Snap=False, Iterative=True)  # -> Aligned, Points, ResultBoolean

number_slider_6 = Slider(600, range=0..5000)
divide_curve = DivideCurve(Curve=align_curve_seams.Aligned, Count=number_slider_6, Kinks=False)  # -> Points, Tangents, Parameters
divide_curve_2 = DivideCurve(Curve=join_curves, Count=number_slider_6, Kinks=False)  # -> Points, Tangents, Parameters
shatter = Shatter(Curve=align_curve_seams.Aligned, Parameters=divide_curve.Parameters)  # -> simplify(graft(Segments))
shatter_2 = Shatter(Curve=join_curves, Parameters=divide_curve_2.Parameters)  # -> simplify(graft(Segments))
point_list = PointList(Points=divide_curve.Points)
point_list_2 = PointList(Points=divide_curve_2.Points)
loft = Loft(
    Curves=[shatter, shatter_2],
    Options={Adjust=False, Closed=False, LoftEnds=0, LoftSimp=0, LoftType=2, Rebuild=10, Refit=0.01})  # -> flatten(Loft)

brep_join = BrepJoin(Breps=loft)  # -> Breps, Closed
settings_speed = SettingsSpeed()
mesh_brep_2 = MeshBrep(Brep=brep_join.Breps, Settings=settings_speed)
merge = Merge(Data1=remeshbycolour_2, Data2=mesh_brep_2, Data3=remeshbycolour)
mesh_join = MeshJoin(Meshes=flatten(merge))
