# Grasshopper definition temperature filed construct.gh (Grasshopper 1.0.8)

number_slider = Slider(10, range=0..10)
division = Division(A=Slider(21, range=0..100), B=number_slider)
series = Series(Start=Slider(447, range=0..1000), Step=division, Count=number_slider)
series_2 = Series(Start=expr("0", 0), Step=Slider(3.4, range=0..10), Count=number_slider)  # -> expr("x*100", Series)
unit_z = UnitZ(Factor=series_2)

panel = Panel("kriging_optimization_results_Universal_gaussian_consider_rss.xlsx")
# Input
panel_2 = Panel("temperature.xlsx")

detailed_model = Slider(5, range=0..10)
construct_point = ConstructPoint(XCoordinate="-478", YCoordinate="-1070", ZCoordinate=0)
mesh = Mesh(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)

rough_model = Slider(100, range=0..100)
script = Script(
    path=panel_2,
    path_para=panel,
    P0=construct_point,
    l_x=Slider(1730, range=0..2200),
    l_y=Slider(1805, range=0..2200),
    step_x=rough_model,
    step_y=rough_model,
    H=series,
    switch=Toggle(True),
    border=Slider(1.1, range=0..10),
    Mesh=mesh)  # -> out, pts, t, Curve; inputs path: String, P0: Point3d, l_x: Double, l_y: Double, step_x: Double, step_y: Double, H: Double, Mesh: Mesh
# ---------- script: Python ----------
import locale
import os
import pandas as pd
import rhinoscriptsyntax as rs
import pandas as pd
import numpy as np
import openpyxl

from pykrige.ok import OrdinaryKriging
from pykrige.uk import UniversalKriging

from scipy.interpolate import interp1d

import ghpythonlib.treehelpers as th
import ghpythonlib.components as gh


def region(mesh,h):
    C = []

    # construct slicing plane at elevation h
    plane = gh.ConstructPlane(rs.CreatePoint(0,0,h),'1,0,0','0,1,0')

    # intersect mesh with plane
    curve = gh.MeshXPlane(Mesh,plane)

    L = gh.Length(curve)
    print(type(L))

    # single curve case
    if isinstance(L,float):
        C.append(curve)
        return C

    # multiple curves case
    else:
        for i in range(len(curve)):
            print(curve[i])

            # filter curves by length
            if gh.Length(curve[i]) > 1000:
                C.append(curve[i])

        return C


class KR_caculate():

    def __init__(self,path,path_para,P,l_x,l_y,step_x,step_y):

        self.path_para = path_para

        # load Excel file containing borehole temperature data
        self.excel_file = pd.ExcelFile(path)
        self.names = self.excel_file.sheet_names

        # define interpolation region
        self.x_r = np.arange(P[0], P[0]+l_x, step_x)
        self.y_r = np.arange(P[1], P[1]+l_y, step_y)

        # initialize height value
        self.h = 0

        modle = ["power", "gaussian", "spherical", "exponential", "hole-effect"]
        self.mo  = modle[1]


    # read borehole data from Excel
    def read_h(self,h):

        self.h = h

        t = []  # interpolated temperature values at elevation h
        x = []  # x coordinates list
        y = []  # y coordinates list

        # loop through boreholes and extract valid data at height h
        for i in range(len(self.names)):

            df = self.excel_file.parse(self.names[i])

            datat = df.iloc[2:, 2].tolist()
            datah = df.iloc[2:, 3].tolist()

            h_max = max(datah)
            h_min = min(datah)

            # check whether h is within borehole depth range
            if (float(h_min) <= h) and (h <= float(h_max)):  

                m = interp1d(datah, datat, bounds_error=False)

                t.append(m(h))

                x.append(df.iloc[2, 4]-466550-143.247864)
                y.append(df.iloc[2, 5]-5246028+3.860982)

        data = np.array([[x[i],y[i],t[i]] for i in range(len(x))])
        return data


    # read variogram parameters from Excel
    def read_para(self, h):

        """
        Extract variogram parameters corresponding to given height h

        Parameters:
            self: class instance
            h: target elevation value

        Returns:
            dictionary of variogram parameters
        """

        # Excel file path
        path_para = self.path_para

        # read Excel file
        try:
            df = pd.read_excel(path_para)
        except Exception as e:
            raise FileNotFoundError(f"cannot read file {path_para}: {e}")

        # required columns check
        required_columns = ['Height', 'Sill', 'Range', 'Nugget', 'Scaling', 'Angle']

        if not all(col in df.columns for col in required_columns):
            raise ValueError(f"Excel must contain columns: {', '.join(required_columns)}")

        matched_row = df['Height'].astype(float)

        # filter rows by height
        matched_row = df[np.abs(df['Height'] - h)<0.001]

        if matched_row.empty:
            raise ValueError(f"No data found for Height = {h}")

        # extract parameters
        variogram_parameters_s = matched_row.iloc[0][
            ['Sill', 'Range', 'Nugget', 'Scaling', 'Angle']
        ].to_dict()

        return variogram_parameters_s


    # kriging interpolation
    def KR(self,h):

        data = self.read_h(h)
        variogram_parameters_s = self.read_para(h)

        OK = UniversalKriging(

            data[:, 0],
            data[:, 1],
            data[:, 2],

            variogram_model=self.mo,

            # variogram parameters
            variogram_parameters={
                'sill': variogram_parameters_s['Sill'],
                'range': variogram_parameters_s['Range'],
                'nugget': variogram_parameters_s['Nugget']
            },

            anisotropy_scaling=variogram_parameters_s['Scaling'],
            anisotropy_angle=variogram_parameters_s['Angle'],

            verbose= False,
            enable_plotting=False,
        )

        z, ss = OK.execute("grid", self.x_r, self.y_r)

        pts = []
        t = []
        f_p = []

        for i in range(len(self.y_r)):
            for j in range(len(self.x_r)):

                # create point at grid location
                p = rs.CreatePoint(self.x_r[j],self.y_r[i],self.h)

                pts.append(p)
                t.append((z[i][j]))

                # filtered points based on threshold
                if z[i][j] < border:
                    f_p.append(p)

        return pts,t,f_p


# duplicate function (kept unchanged, only comments translated)
def region(mesh,h):

    C = []

    # slicing plane
    plane = gh.ConstructPlane(rs.CreatePoint(0,0,h),'1,0,0','0,1,0')

    # mesh-plane intersection
    curve = gh.MeshXPlane(Mesh,plane)

    L = gh.Length(curve)
    print(type(L))

    if isinstance(L,float):
        C.append(curve)
        return C

    else:
        for i in range(len(curve)):

            print(curve[i])

            # filter long segments
            if gh.Length(curve[i]) > 1000:
                C.append(curve[i])

        return C


# main execution block
if switch == True:

    A = KR_caculate(path,path_para,P0,l_x,l_y,step_x,step_y)

    h = H

    pts = A.KR(h)[0]
    t = A.KR(h)[1]

    Curve = region(Mesh,h)
# ---------- end script ----------
curve = Curve(script.Curve)
point_in_curve = PointInCurve(Point=script.pts, Curve=script.Curve)  # -> Relationship, Point
divide_length = DivideLength(Curve=simplify(script.Curve), Length=Slider(24, range=0..100))  # -> Points, Tangents, Parameters
unit_x = UnitX(Factor=Slider(2000, range=0..10000))
gradient = Gradient(
    LowerLimit=16,
    UpperLimit=-3,
    Parameter=script.t,
    stops=[0: RGB(254, 244, 84), 0.014: RGB(252, 241, 83), 0.0468: RGB(255, 244, 84), 0.0693: RGB(252, 241, 83), 0.14: RGB(227, 240, 81), 0.249: RGB(99, 222, 69), 0.395: RGB(99, 222, 69), 0.507: RGB(78, 199, 124), 0.669: RGB(78, 199, 124), 0.715: RGB(67, 139, 145)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])
equality = Equality(FirstNumber=point_in_curve.Relationship, SecondNumber=expr("2", 2))  # -> Equality, Inequality
path_mapper = PathMapper(divide_length.Points, source="{A;B}", target=" {A}")
move = Move(Geometry=script.pts, Motion=unit_x)  # -> Geometry, Transform
point = Point(path_mapper)
dispatch = Dispatch(List=script.t, DispatchPattern=equality.Equality)  # -> ListA, ListB
script_2 = Script(path=panel_2, path_para=panel, H=series, switch=Toggle(True), ed_pts=point)  # -> out, t; inputs path: String, H: list of Double, ed_pts: tree of Point3d
# ---------- script_2: Python ----------
import locale
locale.setlocale(locale.LC_ALL, 'zh_CN')

import pandas as pd
import rhinoscriptsyntax as rs
import numpy as np
import openpyxl

from pykrige.ok import OrdinaryKriging
from pykrige.uk import UniversalKriging

from scipy.interpolate import interp1d

import ghpythonlib.treehelpers as th
import ghpythonlib.components as gh


class Caculate_edge():

    def __init__(self, path, path_para):

        # 钻孔温度数据
        self.excel_file = pd.ExcelFile(path)
        self.names = self.excel_file.sheet_names

        # 变差函数参数
        self.path_para = path_para

        self.h = 0

        model = [
            "power",
            "gaussian",
            "spherical",
            "exponential",
            "hole-effect"
        ]

        # 推荐与主体场保持一致
        self.mo = model[1]

    # =========================================================
    # 读取指定高程下钻孔温度
    # =========================================================
    def read_h(self, h):

        self.h = h

        t = []
        x = []
        y = []

        for i in range(len(self.names)):

            df = self.excel_file.parse(self.names[i])

            datat = df.iloc[2:, 2].tolist()
            datah = df.iloc[2:, 3].tolist()

            h_max = max(datah)
            h_min = min(datah)

            # 当前高程在钻孔范围内
            if (float(h_min) <= h) and (h <= float(h_max)):

                # 高程插值
                m = interp1d(
                    datah,
                    datat,
                    bounds_error=False
                )

                t.append(float(m(h)))

                # 坐标统一到局部坐标系
                x.append(df.iloc[2, 4] - 466550 - 143.247864)
                y.append(df.iloc[2, 5] - 5246028 + 3.860982)

        data = np.array([
            [x[i], y[i], t[i]]
            for i in range(len(x))
        ])

        return data

    # =========================================================
    # 读取变差函数参数
    # =========================================================
    def read_para(self, h):

        df = pd.read_excel(self.path_para)

        required_columns = [
            'Height',
            'Sill',
            'Range',
            'Nugget',
            'Scaling',
            'Angle'
        ]

        if not all(col in df.columns for col in required_columns):
            raise ValueError("参数表缺少必要字段")

        matched_row = df[np.abs(df['Height'] - h) < 0.001]

        if matched_row.empty:
            raise ValueError("未找到对应高程参数")

        para = matched_row.iloc[0][
            [
                'Sill',
                'Range',
                'Nugget',
                'Scaling',
                'Angle'
            ]
        ].to_dict()

        return para

    # =========================================================
    # 提取边界温度
    # pts : Rhino点列表
    # =========================================================
    def edge_value(self, h, pts):

        data = self.read_h(h)

        # 至少需要3个点
        if len(data) < 3:
            raise ValueError("有效钻孔数量不足")

        # 读取对应高程变差参数
        para = self.read_para(h)

        # 建立克里金模型
        OK = UniversalKriging(

            data[:, 0],
            data[:, 1],
            data[:, 2],

            variogram_model=self.mo,

            variogram_parameters={
                'sill': para['Sill'],
                'range': para['Range'],
                'nugget': para['Nugget']
            },

            anisotropy_scaling=para['Scaling'],
            anisotropy_angle=para['Angle'],

            verbose=False,
            enable_plotting=False
        )

        edge_temp = []

        for p in pts:

            # Rhino Point兼容
            x = p.X
            y = p.Y

            z, ss = OK.execute(
                "points",
                x,
                y
            )

            edge_temp.append(float(z))

        return edge_temp

    # =========================================================
    # 输出边界温度场
    # =========================================================
    def edge_field(self, h, pts):

        temp = self.edge_value(h, pts)

        result = []

        for i in range(len(pts)):

            result.append(
                [
                    pts[i].X,
                    pts[i].Y,
                    h,
                    temp[i]
                ]
            )

        return result


# =============================================================
# 主程序
# =============================================================

if switch == True:

    A = Caculate_edge(path, path_para)

    T = []
    FIELD = []
    
    # H 为高程列表
    for i in range(len(H)):

        # 当前高程
        h = H[i]

        # 当前高程对应边界点
        pts = list(ed_pts.Branch(i))

        # 边界温度
        temp = A.edge_value(h, pts)

        # 边界温度场
        field = A.edge_field(h, pts)

        T.append(temp)

        FIELD.append(field)

    # 转换为 Grasshopper Tree
    t = th.list_to_tree(T)

    FIELD = th.list_to_tree(FIELD)
# ---------- end script_2 ----------
script_3 = Script(x=simplify(dispatch.ListA), y=simplify(script_2.t))  # -> out, simplify(a); inputs x: list, y: list
# ---------- script_3: Python ----------
a = []
for i in x:
    a.append(i)
for i in y:
    a.append(i)
# ---------- end script_3 ----------
dispatch_2 = Dispatch(List=move.Geometry, DispatchPattern=equality.Equality)  # -> ListA, ListB
move_2 = Move(Geometry=point, Motion=unit_x)  # -> Geometry, Transform
delaunay_mesh = DelaunayMesh(Points=move.Geometry, Plane=PlaneXY(0, 0, 0))
script_4 = Script(x=dispatch_2.ListA, y=move_2.Geometry)  # -> out, a; inputs x: list of Point3d, y: list of Point3d; same code as script_3
deconstruct_mesh = DeconstructMesh(Mesh=delaunay_mesh)  # -> Vertices, Faces, Colours, Normals
gradient_2 = Gradient(
    LowerLimit=16,
    UpperLimit=-3,
    Parameter=script_3.a,
    stops=[0: RGB(254, 244, 84), 0.014: RGB(252, 241, 83), 0.0468: RGB(255, 244, 84), 0.0693: RGB(252, 241, 83), 0.132: RGB(227, 240, 81), 0.249: RGB(99, 222, 69), 0.395: RGB(99, 222, 69), 0.507: RGB(78, 199, 124), 0.669: RGB(78, 199, 124), 0.715: RGB(67, 139, 145)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])
move_3 = Move(Geometry=script.Curve, Motion=unit_x)  # -> Geometry, Transform
construct_mesh = ConstructMesh(Vertices=deconstruct_mesh.Vertices, Faces=deconstruct_mesh.Faces, Colours=gradient)
custom_preview = CustomPreview(Geometry=move.Geometry, Material=gradient)
delaunay_mesh_2 = DelaunayMesh(Points=script_4.a, Plane=PlaneXY(0, 0, 0))
face_normals = FaceNormals(Mesh=delaunay_mesh_2)  # -> Centers, Normals
point_in_curves = PointInCurves(Point=face_normals.Centers, Curves=move_3.Geometry)  # -> Relationship, Index, Point
deconstruct_mesh_2 = DeconstructMesh(Mesh=delaunay_mesh_2)  # -> Vertices, Faces, Colours, Normals
equality_2 = Equality(FirstNumber=point_in_curves.Relationship, SecondNumber=2)  # -> Equality, Inequality
dispatch_3 = Dispatch(List=deconstruct_mesh_2.Faces, DispatchPattern=equality_2.Equality)  # -> ListA, ListB
custom_preview_2 = CustomPreview(Geometry=script_4.a, Material=gradient_2)
construct_mesh_2 = ConstructMesh(Vertices=deconstruct_mesh_2.Vertices, Faces=dispatch_3.ListA, Colours=gradient_2)  # -> simplify(Mesh)
move_4 = Move(Geometry=simplify(graft(construct_mesh_2)), Motion=simplify(graft(unit_z)))  # -> Geometry, Transform
unit_x_2 = UnitX(Factor=Slider(9000, range=0..9000))

# ----
# Output
move_5 = Move(Geometry=flatten(move_4.Geometry), Motion=unit_x_2)  # -> Geometry, Transform
